# Grasshopper definition single_shape.gh (Grasshopper 1.0.8)

panel = Panel("""A
-7, -4, 2
B
-7, 4, -2
C
7, -2, -4
D
7, 2, 4
E
-1, -2, -8
F
-1, 2, 8
G
1, -8, 2
H
1, 8, -2
I
-3, -6, -3
J
-3, 6, 3
K
3, -3, 6
L
3, 3, -6""")
panel_2 = Panel("""AFKG
AIEB
BELH
CDHL
DCGK
CEIG
ABJF
DHJF
AGI
BHJ
CLE
DKF""")
py3 = Python3Script(vertex_list=panel, topology=panel_2)  # -> out, vertex_labels, vertices, faces; inputs vertex_list: list of String, topology: list of String
# ---------- py3: Python ----------
import Rhino.Geometry as rg

vertex_labels = []
vertices = []
for i,s in enumerate(vertex_list):
    #print(i,s)
    if i%2==0:
        vertex_labels.append(s)
    else:
        p = [float(v) for v in s.split(',')]
        vertices.append(rg.Point3d(*p))

#c = []
faces = []
for f in topology:
    pts = []
    vi = list(f)
    #print(vi)
    for v in vi:
        i = vertex_labels.index(v)
        pts.append(vertices[i])
    pts.append(pts[0])
    #crv = rg.Polyline(pts)
    #c.append(crv)

    srf = rg.NurbsSurface.CreateFromCorners(*pts[:-1])
    faces.append(srf)
# ---------- end py3 ----------
dot = AnnotationDot(Location=py3.vertices, PrimaryText=py3.vertex_labels)  # -> AnnotationDot, Location, PrimaryText, TextHeight
join = BrepJoin(Breps=py3.faces)  # -> Breps, Closed
