# Grasshopper definition unitcell.gh (Grasshopper 1.0.8)

# ---- group: import points
# https://raw.githubusercontent.com/worbit/josehedron/refs/heads/main/3d-data/FKS_minima.txt
path = FilePath("/Users/bernham/Desktop/FKS_minima.txt")
# Josehedron
# https://zenodo.org/records/19471917
py3 = Python3Script(path=path)  # -> out, a; inputs path: String
# ---------- py3: Python ----------
import Rhino.Geometry as rg

a = []

with open(path, 'r') as pointfile:
    lines = pointfile.readlines()
    pt_str = [l.split(',') for l in lines]
    for p in pt_str:
        point = rg.Point3d(*[float(v) for v in p])
        a.append(point)
# ---------- end py3 ----------

# ---- group: Plesiohedron: Voronoi cells around points
voronoi³ = Voronoi3D(Points=py3.a)  # -> Cells, Boundary

# ---- group: only select the ones inside a 8x8x8 unit cell
panel = Panel("0,0,0")
box = Box2Pt(PointA=panel, PointB="7,7,7", Plane=PlaneXY(0, 0, 0))
brepinc = PointInBrep(Brep=box, Point=py3.a, Strict=False)
cull = CullPattern(List=voronoi³.Cells, CullPattern=brepinc)

# ---- group: fill space with translated copies
box_2 = Box2Pt(PointA=panel, PointB="8,8,8", Plane=PlaneXY(0, 0, 0))
arrbox = BoxArray(Geometry=cull, Cell=box_2, XCount="3", YCount="3", ZCount="3")  # -> Geometry, Transform
